# Grasshopper definition Hive_Parametric_Inputs.gh (Grasshopper 1.0.7)
# plug-ins: HiveIO, sia380Parameters

# ----
# Building
number_slider = Slider(16, range=16..30)
list = ValueList({"1.2 Wohnen Einfamilienhaus"}, selected="1.2 Wohnen Einfamilienhaus")
number_slider_2 = Slider(0.25, range=0..1)
rooms_existing = RoomsExisting({"1.1 Wohnen Mehrfamilienhaus": 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, "1.2 Wohnen Einfamilienhaus": {"description": "1.2 Wohnen Einfamilienhaus", "Raumlufttemperatur Auslegung Heizen (Winter)": 21.0, "Nettogeschossflaeche": 20.0, "Thermische Gebaeudehuellflaeche": 38.0, "U-Wert Fenster": 1.5, "Waermeeintragsleistung Personen (bei 24.0 deg C, bzw. 70 W)": 1.3999999999999999, "Jaehrliche Vollaststunden der Geraete": 1780.0, "U-Wert opake Bauteile": 0.80000000000000004, "Jaehrliche Vollaststunden der Raumbeleuchtung": 1450.0, "Vollaststunden pro Jahr (Personen)": 4090.0, "Abminderungsfaktor fuer Fensterrahmen": 0.75, "Aussenluft-Volumenstrom durch Infiltration": 0.29999999999999999, "Raumlufttemperatur Auslegung Kuehlung (Sommer)": 26.0, "Glasanteil": 30.0, "Zeitkonstante": 56.0, "Waermeeintragsleistung der Raumbeleuchtung": 2.7000000000000002, "Waermeeintragsleistung der Geraete": 10.0, "Gesamtenergiedurchlassgrad Verglasung": 0.65000000000000002, "Temperatur-Aenderungsgrad der Waermerueckgewinnung": NaN, "Aussenluft-Volumenstrom (pro NGF)": 0.59999999999999998}, "2.1 Hotelzimmer": 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, "2.2 Empfang, Lobby": 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, "3.1 Einzel-, Gruppenbuero": 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, "3.2 Grossraumbuero": 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, "3.3 Sitzungszimmer": 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, "3.4 Schalterhalle, Empfang": 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, "4.1 Schulzimmer": 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, "4.2 Lehrerzimmer": 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}, selected="1.2 Wohnen Einfamilienhaus")
srf = Surface([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])
brep = Brep(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)
nickname = GhParametricInputSIARoom(
    Descriptiont=list,
    RoomConstant=Slider(50, range=50..300),
    CoolingSetpoint=Slider(16, range=16..30),
    HeatingSetpoint=number_slider,
    FloorArea=number_slider_2,
    EnvelopeArea=number_slider_2,
    GlazingRatio=number_slider_2,
    UValueOpaque=number_slider_2,
    UValueTransparent=number_slider_2,
    GValue=number_slider_2,
    WindowFrameReduction=number_slider_2,
    AirChangeRate=number_slider_2,
    Infiltration=number_slider_2,
    HeatRecovery=number_slider_2,
    OccupantLoads=number_slider_2,
    LightingLoads=number_slider_2,
    EquipmentLoads=number_slider_2,
    OccupantYearlyHours=number_slider_2,
    LightingYearlyHours=number_slider_2,
    EquipmentYearlyHours=number_slider_2,
    OpaqueCost=number_slider_2,
    TransparentCost=number_slider_2,
    OpaqueEmissions=number_slider_2,
    TransparentEmissions=number_slider_2)
panel = Panel(nickname)
hive_io_bldg = HiveIOBuilding(ZoneBrepGeometries=brep, WindowsSurfaces=srf, SIA2024Room=nickname)
panel_2 = Panel(hive_io_bldg)

# ----
# EnergySystems
number_slider_3 = Slider(0, range=0..100)
number_slider_4 = Slider(0, range=0..100)
number_slider_5 = Slider(0.25, range=0..100)
mesh = Mesh(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)
emitterinputs = HiveIOEnergySystemsEmitter(Vorlauf="65", Rücklauf="55", Capacity="1.0", InvestmentCost="200", EmbodiedEmissions="50")
nickname_2 = GhParametricInputEnergySystems(
    ASHPCapacity=number_slider_5,
    ASHPCost=number_slider_5,
    ASHPEmissions=number_slider_5,
    ASHPCOP=number_slider_5,
    NGBoilerCapacity=number_slider_3,
    NGBoilerCost=number_slider_3,
    NGBoilerEmissions=number_slider_3,
    NGBoilerEfficiency=number_slider_3,
    CHPCapacity=number_slider_4,
    CHPCost=number_slider_4,
    CHPEmissions=number_slider_4,
    CHPHTP=number_slider_4,
    CHPEffElec=number_slider_4)
nickname_3 = GhParametricInputSolarSystems(
    Mesh=mesh,
    Type="PV",
    Technology="A/S wow tech",
    EfficiencyElectric="0.3",
    EfficiencyThermal="0.0",
    InvestmentCost="3000",
    EmbodiedEmissions="200")  # -> Mesh, Json
panel_3 = Panel(emitterinputs)
panel_4 = Panel(nickname_3.Json)
panel_5 = Panel(nickname_2)
energysystems = HiveIOEnergySystems(Mesh=nickname_3.Mesh, SolarTechJson=nickname_3.Json, ConversionTechJson=nickname_2, EmitterJson=emitterinputs)  # -> HiveIOEnergySystemsConversionTech, HiveIOEnergySystemsEmitter
panel_6 = Panel(energysystems.HiveIOEnergySystemsConversionTech)
python = GhPythonScript(x=energysystems.HiveIOEnergySystemsEmitter)  # -> out, a
# ---------- python: Python ----------
__author__ = "chwaibel"
__version__ = "2020.08.11"

import rhinoscriptsyntax as rs

a= x.SpecificInvestmentCost
# ---------- end python ----------
panel_7 = Panel(python.a)
python_2 = GhPythonScript(x=energysystems.HiveIOEnergySystemsConversionTech)  # -> out, a; inputs x: list
# ---------- python_2: Python ----------
__author__ = "chwaibel"
__version__ = "2020.08.11"

import rhinoscriptsyntax as rs

for tech in x:
    print(tech.Name)
    print(tech.Capacity)
# ---------- end python_2 ----------
panel_8 = Panel(python_2.out)

# ----
# Environment
panel_9 = Panel("UCT-Mix")
python_3 = GhPythonScript()  # -> out, a
# ---------- python_3: Python ----------
__author__ = "chwaibel"
__version__ = "2020.08.19"

import rhinoscriptsyntax as rs

a = [0.1] * 8760
# ---------- end python_3 ----------
panel_10 = Panel("C:\Users\chwaibel\Documents\GitHub\hive\GrasshopperExamples\LectureExercises\HIVE_Zurich.epw")
hiveparainpotentials = ParametricInputEnergyPotantialsHive(
    NaturalGasName="gazprom",
    NaturalGasPrice=python_3.a,
    NaturalGasEmissions=python_3.a,
    NaturalGasAvailability=python_3.a,
    BioGasName="Altstetten-Biogas",
    BioGasPrice=python_3.a,
    BioGasEmissions=python_3.a,
    BioGasAvailability=python_3.a,
    WoodPelletsName="ZuriWald",
    WoodPelletsPrice=python_3.a,
    WoodPelletsEmissions=python_3.a,
    WoodPelletsAvailability=python_3.a,
    DistrictHeatingName="Schwamendingen",
    DistrictHeatingPrice=python_3.a,
    DistrictHeatingEmissions=python_3.a,
    DistrictHeatingAvailability=python_3.a,
    DistrictHeatingSupplyTemp=python_3.a,
    DistrictCoolingName="Zurilake",
    DistrictCoolingPrice=python_3.a,
    DistrictCoolingEmissions=python_3.a,
    DistrictCoolingAvailability=python_3.a,
    DistrictCoolingSupplyTemp=python_3.a,
    GridElectricityName=panel_9,
    GridElectricityPrice=python_3.a,
    GridElectricityEmissions=python_3.a,
    GridElectricityAvailability=python_3.a)
panel_11 = Panel(hiveparainpotentials)
hiveinputenvironment = InputEnvironmentHive(EPWPath=panel_10, Potentials=hiveparainpotentials)

panel_12 = Panel(energysystems.HiveIOEnergySystemsEmitter)
